# Grasshopper definition Initial_CLT_Algorithms.gh (Grasshopper 1.0.7)

python = GhPythonScript()  # -> a, b, snapshots; inputs curve: list of Curve
# ---------- python: Python ----------
import ghpythonlib.components as gh
import rhinoscriptsyntax as rs 
import Rhino as rc 
import scriptcontext as sc
from itertools import chain
import math
import operator 
from operator import itemgetter
import random 

def argmin(a):
    return min(enumerate(a), key=itemgetter(1))[0]
    
def shortestSegment(csrf):  
    c_edge = gh.BrepEdges(csrf).naked
    c_join = gh.JoinCurves(c_edge,False)
    c_exp = gh.Explode(c_join,True).segments
    c_ext = gh.ExtendCurve(c_exp,0,0.001,0.001)
    c_add = gh.Addition(gh.GateNot(gh.SurfaceClosestPoint(gh.EndPoints(c_ext).start,csrf).distance),
                        gh.GateNot(gh.SurfaceClosestPoint(gh.EndPoints(c_ext).end,csrf).distance))
    c_add = gh.Addition(gh.Multiplication(gh.MassAddition(gh.Length(c_join)).result,c_add),
                        gh.Length(c_exp))
    c_series = gh.Series(0,1,gh.ListLength(c_exp))
    c_shortest = gh.ListItem(gh.SortList(c_add,c_series).values_a,0,True)
    return c_exp, int(c_shortest)
    
def getAdjacentSegments(segments, shortest):
    starts, ends = gh.EndPoints(segments)
    base_a, base_b = starts[shortest], ends[shortest]
    adj_a = None 
    adj_b = None
    for i in range(len(segments)):
        if(i==shortest):
            continue
        else: 
            if(adj_a!=None and adj_b!=None): 
                break
            if(starts[i]==base_a or ends[i]==base_a):
                adj_a = i 
            elif(starts[i]==base_b or ends[i]==base_b):
                adj_b = i
    return [adj_a, shortest, adj_a]

def lastRectangle(outline,ext):
    a = gh.Area(outline)
    b = gh.Area(ext)
    cent_dist = gh.Distance(a.centroid,b.centroid)
    abs_dif = gh.Absolute(gh.Subtraction(a.area,b.area))
    return (abs_dif<0.01 and cent_dist<0.01)
    
def searchIntersections(outline,base,normal,min_arm):
    base_ends = gh.EndPoints(base)
    discos = gh.Discontinuity(gh.BrepEdges(outline).naked, 1).points
    intersect = 1.0 
    
    dir_index = 0
    if(round(base_ends[0][0])==round(base_ends[1][0])):
        dir_index = 1
    op_index = (dir_index+1)%2
    a, b = sorted(base_ends, key = lambda co: co[dir_index])
    unit_normal = gh.UnitVector(normal) 
    oper = 'gt'
    if(unit_normal[op_index]<0):
        oper = 'lt'
        
    for pt in discos: 
        if(pt[dir_index]==a[dir_index] and pt[op_index]==b[op_index] or pt[dir_index]==b[dir_index] and pt[op_index]==b[op_index]):
            continue
        else:
            if(pt[dir_index]>=a[dir_index] and pt[dir_index]<=b[dir_index] and getattr(operator,oper)(pt[op_index],a[op_index])):
                param = abs(pt[op_index]-a[op_index])/min_arm
                if(param<intersect):
                    intersect=param
    return intersect
    
def createRoom(adjacents,segments,outline):
    arm_a = segments[adjacents[0]]
    base = segments[adjacents[1]]
    arm_b = segments[adjacents[2]]
    vec = gh.Vector2Pt(gh.EndPoints(base).start,gh.EndPoints(arm_a).start,False).vector
    min_arm = gh.Minimum(gh.Length(arm_a),gh.Length(arm_b))
    intersect = searchIntersections(outline, base, vec, min_arm)
    amp = gh.Amplitude(vec,min_arm*intersect)
    new_edge = gh.Move(base,amp).geometry
    base_a, base_b = gh.EndPoints(base)
    new_a = gh.LineSDL(base_a,amp,gh.VectorLength(amp))
    new_b = gh.Pufferfish.MoveToPoint(new_a, base_a, base_b).moved
    room = gh.BoundarySurfaces(gh.JoinCurves([base, new_a, new_b, new_edge],False))
    if(lastRectangle(outline,room)):
        return outline, room, True
    else: 
        split = gh.SplitBrep(outline, room)
        outline = split[1]
        return outline, room, False
    
    
outline = gh.BoundarySurfaces(curve)
b = gh.Area(outline).centroid
output = []
i = True
while(i==True):
    segments, shortest = shortestSegment(outline)
    adjacents = getAdjacentSegments(segments, shortest)
    remainder, room, last= createRoom(adjacents,segments,outline)
    output.append(room)
    b_curves = gh.JoinCurves(gh.BrepEdges(remainder).naked,False)
    if(last):
        i=False
    else: 
        if(isinstance(b_curves,list)):
            poly = []
            for c in b_curves:
                poly.append(gh.PolyLine(gh.Discontinuity(c,1).points,True))
        else:
            poly = gh.PolyLine(gh.Discontinuity(b_curves,1).points,True)
        outline = gh.BoundarySurfaces(poly)
a = output
# ---------- end python ----------
python_2 = GhPythonScript(outline_cent=python.b)  # -> mepSpans, mepx, mepy; inputs regions: list of Curve, outline_cent: Point3d
# ---------- python_2: Python ----------
import ghpythonlib.components as gh
import rhinoscriptsyntax as rs 
import Rhino as rc 
import scriptcontext as sc
import math
import random 
import operator
import itertools

#class object initialized with "room" data 
#   -self.x & self.y: store midpoint lines generated by mepCross()
#   -self.x_range & self.y_range: extract and store the span of their respective midline 
class mepSpan:  
    def __init__(self,room):
        self.room = room
        self.x, self.y = self.mepCross(room)
        self.x_range = [(min(self.x[0][0],self.x[1][0])),(max(self.x[0][0],self.x[1][0]))]
        self.y_range = [(min(self.y[0][1],self.y[1][1])),(max(self.y[0][1],self.y[1][1]))]
        self.x_channel = []
        self.y_channel = []
        self.max_span = 13
        self.orient = [None,None]
        

    #calculates the difference of a given x_range or y_range
    def rangeLength(self,range):
        return range[1]-range[0]
        
    #returns the midpoint lines of a given parallelogram 
    #draws a line between the midpoint of opposing line segments 
    #NB: the ordering of segments resulting from gh.Explode() is not standard
    #   -to assign segment to appropriate variable (x or y), take the crossproduct of segment A and unit X
    def mepCross(self,room):
        edges = gh.Explode(room,True).segments
        edges = gh.Pufferfish.ReparameterizeCurve(edges).reparameterized
        a = gh.Line(gh.EvaluateCurve(edges[0],0.5).point,gh.EvaluateCurve(edges[2],0.5).point)
        b = gh.Line(gh.EvaluateCurve(edges[1],0.5).point,gh.EvaluateCurve(edges[3],0.5).point)
        if(gh.CrossProduct(gh.UnitY(1),a,False).length>=1):
            return a,b
        else:
            return b,a
    
    def addChannel(self,dir,vect):
        loc = int(dir=='x')
        attr = dir+'_channel'
        channel = getattr(self, attr)
        new = gh.Move(getattr(self,dir),vect).geometry
        index = len(channel)
        for el in range(len(channel)):
            if(channel[el][loc]<new[loc]):
                index = el
        channel.insert(index,new)
                         
            
#generic print function for debugging 
#prints the original (enumerated) index of spans as they appear in current 2D structuring
def printIndices(spans):
    ind = []
    for i in spans: 
        bunch = [] 
        for j in i:
            bunch.append(j[0])
        ind.append(bunch)
    print(ind)
    return(ind)
    
def checkOverlap(cur, max_east, min_west,dir):
    cur_east, cur_west = map(round,getattr(cur[1],dir))
    min_lap = min(20,abs(cur_west-cur_east)/8)
    within = False
    if(cur_east<=min_west and cur_west>=max_east):
        within = True
        if(cur_east>=max_east):
            max_east = cur_east
        if(cur_west<=min_west):
            min_west = cur_west
    return within, max_east, min_west
        
def runDir(overlapping, cur_north, cur_south, neighbors, opdir, max_east, min_west, dir):
    north, south = [list(a) for a in zip(*[map(round,getattr(obj[1],opdir)) for obj in overlapping])]
    if(cur_north not in south and cur_south not in north):
        return neighbors 
    else: 
        next_north, next_south = map(round,getattr(overlapping[0][1],opdir))
        within, new_east, new_west = checkOverlap(overlapping[0], max_east, min_west, dir)
        if(within):
            if(next_north == cur_south): 
                neighbors.append(overlapping[0])
                cur_south = next_south
                max_east = new_east
                min_west = new_west
            elif(next_south == cur_north):
                neighbors.insert(0,overlapping[0])
                cur_north = next_north
                max_east = new_east
                min_west = new_west
            else: 
                tmp = overlapping.pop(0)
                overlapping.append(tmp)
        else: 
            overlapping.pop(0)
        return runDir(overlapping,cur_north,cur_south,neighbors,opdir,max_east,min_west,dir)
                
def overlappingSpans(spans,cur,dir,opdir):
    east, west = zip(*[map(round,getattr(obj[1],dir)) for obj in spans])
    cur_east, cur_west = map(round,getattr(cur[1],dir))
    min_lap = min(20,abs(cur_west-cur_east)/8)
    overlapping = [cur]
    for i in range(len(spans)):
        if(cur_east+min_lap<west[i] and cur_west-min_lap>east[i]):
            overlapping.append(spans[i])
    contig = []
    if(len(overlapping)>1):
       cur_north, cur_south = map(round,getattr(overlapping[0][1],opdir))
       neighbors = runDir(overlapping[1:], cur_north, cur_south, [overlapping[0]], opdir, cur_east, cur_west, dir)
       contig = neighbors
    if(contig==[]):
        contig.append(overlapping[0])
    return contig
    
def reqColinear (spans,dir,opdir):
    colinear = []
    col_set = []
    enum = list(enumerate(spans))
    if(len(enum)==1):
        col_set.append(enum)
    else:
        for i in range(len(enum)):
            colinear.append(sorted(overlappingSpans(enum[:i]+enum[i+1:],enum[i],dir,opdir), key=lambda el: -len(el)))
        col_set = [list(y) for y in set(tuple(x) for x in colinear)]
    return col_set
            

def placeMEP(colinear,dir,edge=True,orient="interior"):
    dict = {'x_range':['y_range','x',1,lambda f: gh.UnitY(f)],
            'y_range':['x_range','y',0,lambda f: gh.UnitX(f)]}
    print(len(colinear))
    for i in range(len(colinear)):
        op_start, op_stop = zip(*[getattr(obj[1],dict[dir][0]) for obj in colinear[i]])
        SE, NW = max(op_start), min(op_stop)
        remainder = 0 
        if(edge==False):
            remainder = (NW-SE)%colinear[i][0][1].max_span
        edges = [SE+remainder, NW-remainder]
        card = ['E','W','S','N']
        if(orient=="interior"):
            shift = min(edges, key=lambda d: abs(outline_cent[dict[dir][2]]-d))
        else: 
            shift = max(edges, key=lambda d: abs(outline_cent[dict[dir][2]]-d))
        yadd = 2
        if(dir=='y_range'):
            yadd=0
        
        
        if((NW-SE)<=colinear[i][0][1].max_span):
            card = card[(edges.index(shift)+1)%2+yadd]
        else: 
            card = card[edges.index(shift)+yadd]
        for k in range(len(colinear[i])):
            span = colinear[i][k][1]
            mep = getattr(span,dict[dir][1])
            dif = shift-mep[0][dict[dir][2]]
            if(yadd==2):
                span.orient[1] = card
            else:
                span.orient[0] = card
            print(card)
            span.addChannel(dir[0],dict[dir][-1](dif))

spans = []  
for ele in regions:
    ele = mepSpan(ele)
    spans.append(ele)

xcol = reqColinear(spans,'x_range','y_range')
printIndices(xcol)
placeMEP(xcol,'y_range')

ycol = reqColinear(spans,'y_range','x_range')
printIndices(ycol)
placeMEP(ycol,'x_range')

mepx = []
mepy = []

for i in range(len(spans)):
    for j in spans[i].y_channel:
        mepy.append(j)
    for k in spans[i].x_channel:
        mepx.append(k)

mepSpans = spans
# ---------- end python_2 ----------
python_3 = GhPythonScript(mepSpans=python_2.mepSpans)  # -> flatten(pts); inputs mepSpans: list, i: Int32
# ---------- python_3: Python ----------
import ghpythonlib.components as gh
import rhinoscriptsyntax as rs 
import Rhino as rc 
import scriptcontext as sc
import math
import random 
import operator
import itertools

"""pseudo 
CLT can be manufactured at almost any dimension but shipping imposes a constraint. The optimal span
length taking into account the dimensions of a typical flat-bed or shipping container comes out to 
13ft. Not every plot or floor plan will be evenly divisible by the optimal span length. It comes down
to a design question how to handle this for each section of a floor plan.  

Options: 
1. Justify 
We could keep regular non-optimal span lengths so that the spacing of columns is regular. 

2. Shift Modulo 
We keep the optimal span length and have at most 2 sides of a rectangle that have extra. These could
areas could be corridors where the columns are out of sight anyway. We can designate which two sides of 
a given section will be corridors. By default, we set the interior sides (those closest to the center of the 
floorplan to have the excess). 
"""


    
def getUpperLeft(pts):
    upperleft = pts[0]
    for i in range(len(pts)):
        min_x = round(upperleft[0])
        max_y = round(upperleft[1])
        if(round(pts[i][0])<=min_x and round(pts[i][1])>=max_y):
            upperleft = pts[i]
    return upperleft

def placeVertices(mepSpan):
    max_span = mepSpan.max_span
    orient = mepSpan.orient
    print(orient)
    upperleft = getUpperLeft(gh.Explode(mepSpan.room,True).vertices)
    
    
    x_range, y_range = mepSpan.x_range[1]-mepSpan.x_range[0], mepSpan.y_range[1]-mepSpan.y_range[0]
    latnum = int(x_range//max_span)+2
    longnum = int(y_range//max_span)+2 
    x_gen, y_gen= max_span, max_span
    
#    ref = upperleft
#    x_mult = 1
#    y_mult = 1
#    upperright = gh.Move(upperleft,gh.UnitX(x_range)).geometry
#    if(orient[0]=='E'):
#        ref = upperright
#        x_mult = -1
#    bottom = gh.Move(ref, gh.UnitY(-y_range)).geometry
#    if(orient[1]=='N'):
#        ref = bottom
#        y_mult = -1
#    pts = [ref]
#    x_range = x_range*x_mult 
#    y_range = -y_range*y_mult
#    for i in range(0,longnum):
#        for j in range(0,latnum):
#            if(i==0 and j==0):
#                continue
#            x_comp = x_gen*j*x_mult
#            y_comp = -y_gen*i*y_mult
#            if(j==latnum-1 and i==longnum-1):
#                vec = gh.VectorXYZ(x_range,y_range,0).vector
#            elif(j==latnum-1):
#                vec = gh.VectorXYZ(x_range,y_comp,0).vector
#            elif(i==longnum-1):
#                vec = gh.VectorXYZ(x_comp,y_range,0).vector
#            else: 
#                vec = gh.VectorXYZ(x_comp,y_comp,0).vector
#            pts.append(gh.Move(ref, vec).geometry)
    return pts

pts = []
for span in mepSpans:
    pts.extend(placeVertices(span))
#pts.extend(placeVertices(mepSpans[i]))
# ---------- end python_3 ----------
