# Grasshopper definition floor_plan_generator.gh (Grasshopper 1.0.7)

number_slider = Slider(0, range=0..100)
crv = Curve([<curve referenced from the Rhino model> x4])
python = GhPythonScript(curve=crv, num=number_slider)  # -> chord, regions, vertex, edges; inputs curve: list of Curve
# ---------- python: Python ----------
import ghpythonlib.components as gh
import rhinoscriptsyntax as rs 
import Rhino as rc 
import scriptcontext as sc
from itertools import chain
from itertools import groupby
import math
import operator 
from operator import itemgetter

        
#returns the index of the minimum element in an array
def argmin(a):
    return min(enumerate(a), key=itemgetter(1))[0]
    
#returns the index of the maximum element in an array
def argmax(a):
    return max(enumerate(a), key=itemgetter(1))[0]
    
#returns the index of an element in a if it is equal to an element in b
def argeq(a,b):
    a_index = None
    for i in range(len(b)):
        for j in range(len(a)):
            if(abs(b[i][0]-a[j][0])<0.1 and abs(b[i][1]-a[j][1])<0.1):
                a_index = j
    return a_index
    
"""
Definition:
    a Corner is a data structure that contains information on the intersection 
    between two line segments and how 
"""
class Corner:
    def __init__(self, leg_a, vertex, leg_b):
        self.prev = None
        self.vertex = vertex
        self.next = None
        self.prev_edge = leg_a
        self.next_edge = leg_b
        self.vertical, self.horizontal = self.assignLegs(leg_a,leg_b)
        self.concave = False 
        self.xcol = None
        self.ycol = None 
        
    def assignLegs(self,leg_a,leg_b):
        endpts = gh.EndPoints(leg_a)
        if(endpts[0][0]==endpts[1][0]):
            vertical = leg_a
            horizontal = leg_b
        else: 
            vertical = leg_b 
            horizontal = leg_a
        return vertical,horizontal

class cornerList: 
    def __init__(self):
        self.head = None
        self.tail = None
        self.length = 0
        self.concave_count = 0 
        self.colinear_pairs = 0 
        
    def make(self, new_corner): 
        new_corner.next = self.head
        if(self.head!=None):
            self.head.prev = new_corner
        else: 
            self.tail = new_corner
        self.head = new_corner
        self.head.prev = self.tail
        self.tail.next = self.head
        self.length+=1

    def stitch(self, prev_corner, new_corner, next_corner): 
        horver = ["horizontal","vertical"]
        if(getattr(next_corner,horver[0])!=next_corner.prev_edge):
            horver = horver[::-1]
        next_corner.prev = new_corner
        next_corner.prev_edge = new_corner.next_edge
        new_corner.next = next_corner
        prev_corner.next = new_corner
        prev_corner.next_edge = new_corner.prev_edge
        new_corner.prev = prev_corner
        setattr(next_corner,horver[0],new_corner.next_edge)
        setattr(prev_corner,horver[1],new_corner.prev_edge)
        
    def updateState(self):
        start = self.head
        current_corner = start.next
        self.length = 1
        self.concave_count = 1*start.concave
        while current_corner != start:
            self.length+=1
            self.concave_count+=1*current_corner.concave
            current_corner = current_corner.next
    
    def reverseCorners(self):
        current = self.head
        for i in range(self.length):
            tmp = current.prev
            current.prev = current.next
            current.next = tmp
            tmp_edge = current.prev_edge
            current.prev_edge = current.next_edge
            current.next_edge = tmp_edge
            current = current.next
        self.tail = self.head.prev
        
        
def drawBounding(vertices):
    sorted_indices = [i[0] for i in sorted(enumerate(vertices), key=lambda x:(x[1][0],x[1][1]))]
    bottom_left = vertices[sorted_indices[0]]
    top_right = vertices[sorted_indices[-1]]
    bounding = gh.Rectangle2Pt(gh.XYPlane(bottom_left),bottom_left,top_right,0).rectangle
    return bounding, sorted_indices[0]

"""
A leftmost point must be convex.
Call that vertex V, the previous one is U and the next one is W.
Find the vectors a = U - V and b = W - V. Now compute z = ax * by - ay * bx and note the sign of z.
(This is the z component of the cross product [a 0] X [b 0]. The sign says whether going from U to V to W is a "left turn" or "right turn" in the 2D plane.)
Then continue around the polygon. At each vertex do the same computation where V is the current vertex, U the previous one, and W the next. If the result has the same sign as the first, it's concave, else convex.
"""    
def filterConcaveVertices(curve):
    concave = []
    labelled_edges = []
    if(len(curve)>1):
        inside = 0 
        max_area_index = argmax(gh.Area(curve).area)
        curve.insert(0,curve.pop(max_area_index))
    else:
        inside = 0
    corner_lists = []
    for i in range(len(curve)):
        corner_lists.append(cornerList())
        edges, vertices = gh.Explode(curve[i],False)
        vertices.pop(-1)
        bounding, leftmost = drawBounding(vertices)
        for j in range(len(vertices)):
            V = vertices[(leftmost+j)%len(vertices)]
            leg_a = edges[(leftmost+j-1)%len(vertices)]
            leg_b = edges[(leftmost+j)%len(vertices)]
            z = gh.CrossProduct(leg_a,leg_b,False).vector
            dot = gh.DotProduct(z,gh.UnitZ(1),True)
            labelled_edges.append(sorted(gh.EndPoints(leg_a),key=lambda coor: (coor[0],coor[1])))
            new_corner = Corner(leg_b, V, leg_a)
            if(j==0):
                sign = dot
                if(i>inside):
                    concave.append(V)
                    new_corner.concave=True
                    corner_lists[i].concave_count+=1
            elif(i==inside and dot!=sign):
                concave.append(V)
                new_corner.concave=True
                corner_lists[i].concave_count+=1
            elif(i>inside and dot==sign):
                concave.append(V)
                new_corner.concave=True
                corner_lists[i].concave_count+=1
                
            corner_lists[i].make(new_corner)
    return concave, labelled_edges, corner_lists, bounding

def findCogridVertices(concave, ind):
    sorted_concave = sorted(concave, key=lambda coor: (coor[ind], coor[(ind+1)%2])) 
    mark = sorted_concave[0]
    matched = False
    colinear = []
    for i in range(1,len(sorted_concave)):
        if(mark[ind]==sorted_concave[i][ind]):
            colinear.append([mark,sorted_concave[i]])
        mark = sorted_concave[i]
    return colinear 
        
def constructChords(cogrid_pairs, labelled_edges):
    chords = []
    for i in range(len(cogrid_pairs)): 
        for j in range(len(cogrid_pairs[i])-1):
            if([cogrid_pairs[i][j],cogrid_pairs[i][j+1]] not in labelled_edges):
                if([cogrid_pairs[i][j+1],cogrid_pairs[i][j]] not in labelled_edges):
                    chords.append(gh.Line(cogrid_pairs[i][j],cogrid_pairs[i][j+1]))
    return chords
 
def sortTransverseSegments(corner, corner_lists, horver, dir, oper):
    opdir = (dir+1)%2
    base = getattr(corner,horver[dir])
    horver = horver[opdir]
    base_endpts = sorted(gh.EndPoints(base),key=lambda x:x[dir])
    mid = (base_endpts[0][dir]+base_endpts[1][dir])/2
    trans = []
    intersection_corner = None
    intersection_list = None
    ext_length = 0
    
    
    for i in range(len(corner_lists)): 
        if(i==0):
            current_corner = corner.next.next
            clip = 3
        else: 
            current_corner = corner_lists[i].head
            clip = 0
        
        for j in range(corner_lists[i].length-clip):
            current_edge = getattr(current_corner,horver)
            
            if(current_edge!=current_corner.prev_edge):
                endpts = gh.EndPoints(current_edge)
                opend = sorted(endpts, key=lambda x: x[opdir])
#                print(oper, endpts[0][dir], corner.vertex[dir])
                if(oper(endpts[0][dir],corner.vertex[dir])):
                    if(opend[0][opdir]<=corner.vertex[opdir] and opend[1][opdir]>=corner.vertex[opdir]):
                        current_distance = abs(endpts[0][dir]-corner.vertex[dir])
                        if(intersection_corner==None):
                            intersection_corner = current_corner
                            ext_length = abs(endpts[0][dir]-corner.vertex[dir])
                            intersection_list = i
                        elif(ext_length>current_distance):
                            intersection_corner = current_corner
                            ext_length = current_distance
                            intersection_list = i
                        #print(i,ext_length,current_distance,corner.vertex[dir],endpts[0][dir],mid)
            current_corner = current_corner.next
    return intersection_corner, ext_length, intersection_list
                
def extendCurve(ext_corner,corner_lists,dir):
    horver = ["horizontal","vertical"]
    ray = getattr(ext_corner,horver[dir])
    endpts = sorted(gh.EndPoints(ray),key = lambda x: x[dir])
    vertex = ext_corner.vertex
    
    if(vertex==endpts[0]):
        extend_point = endpts[1]
    else: 
        extend_point = endpts[0]
    
    vect = gh.Vector2Pt(extend_point,vertex,False)
    
    if(gh.DotProduct(gh.VectorXYZ(1,1,1).vector,vect.vector,True)<0):
        oper = operator.lt
    else: 
        oper = operator.gt
    
    intersection_corner, ext_length, intersection_list = sortTransverseSegments(ext_corner, corner_lists, horver, dir, oper)
    ext_cross = gh.CrossProduct(ext_corner.prev_edge,ext_corner.next_edge,True).vector
    intersection_cross = gh.CrossProduct(intersection_corner.prev_edge,intersection_corner.next_edge,True).vector
    #print(ext_cross,intersection_cross)
    if(ext_cross==intersection_cross and intersection_list>0):
        print("Reversing intersection list")
        corner_lists[0].reverseCorners()
        #intersection_corner = intersection_corner.prev
    return gh.LineSDL(vertex,vect.vector,ext_length), intersection_corner, intersection_list, horver

def updateColCounts(shortlist, longlist, corner, dir):
    col = getattr(corner,dir)
    if(col!=None):
        if(shortlist.get(col)==None):
            comp_corner = longlist.get(col)
            setattr(comp_corner,ycol,None)
            setattr(corner,ycol,None)
            shortlist.colinear_count-=1
            longlist.colinear_count-=1
            
def updateColinearCorners(a_list, b_list):
    if(a_list.length>=b_list.length):
        shortlist = b_list
        longlist = a_list
    else: 
        shortlist = a_list
        longlist = b_list
    curcorn = shortlist.head
    for i in range(shortlist.length): 
        updateColCounts(shortlist, longlist, curcorn, 'ycol')
        updateColCounts(shortlist, longlist, curcorn, 'xcol')
        curcorn = curcorn.next

def cornersToCurve(corner_list): 
    segments = []
    curcorner = corner_list.head
    for i in range(corner_list.length): 
        segments.append(curcorner.next_edge)
        curcorner = curcorner.next
    curve = gh.JoinCurves(segments,False)
    return curve
"""
Definitions:
leg_a: vertex edge parallel to chord 
leg_b: vertex edge perpindicular to chord
Region A is the region formed by joining the chord leg a
Region B is the region formed by taking the chord as a standalone segment

"""
def doPartition(ext_corner, chord, intersection_corner, intersection_list, corner_lists, horver, dir):
    opdir = (dir+1)%2
    a_list = corner_lists[0]
    intersection_vertex = chord[1]
        
    intersection_edge = intersection_corner.next_edge
    endpts = gh.EndPoints(intersection_edge)
    
    ray = getattr(ext_corner,horver[dir])
    a_seg = gh.JoinCurves([chord,ray],False)
    ab_shard = [gh.Line(chord[1],endpts.start),gh.Line(chord[1],endpts.end)]
    
    #make ab_shard[1] the segment attached to B-corner
    if(ray==ext_corner.next_edge):
        perp = ext_corner.prev_edge
    else: 
        perp = ext_corner.next_edge
    
    perp_ends = gh.EndPoints(perp)
    if(perp_ends[0]==ext_corner.vertex):
        perp_vect = gh.Vector2Pt(ext_corner.vertex,perp_ends[1],True).vector
    else: 
        perp_vect = gh.Vector2Pt(ext_corner.vertex,perp_ends[0],True).vector
    
    if(gh.DotProduct(perp_vect,ab_shard[0],True)==1):
        ab_shard = ab_shard[::-1]
        
    if(intersection_corner.vertex==ab_shard[1][1]):
        b_corner = Corner(ab_shard[1],intersection_vertex,chord)
        b_prev = intersection_corner
        b_next = ext_corner
        a_corner = Corner(a_seg,intersection_vertex,ab_shard[0])
        a_prev = ext_corner.prev
        a_next = intersection_corner.next
    else: 
        a_corner = Corner(ab_shard[0],intersection_vertex,a_seg)
        a_prev = intersection_corner
        a_next = ext_corner.next
        b_corner = Corner(chord,intersection_vertex,ab_shard[1])
        b_prev = ext_corner
        b_next = intersection_corner.next
        
    a_list.stitch(a_prev, a_corner, a_next)
    a_list.head = a_corner
    a_list.tail = a_prev
    
    a_list.stitch(b_prev, b_corner, b_next)
    ext_corner.concave = False
    a_list.updateState()
    
    b_list = None
    if(intersection_list==0):
        b_list = cornerList()
        b_list.head = b_corner
        b_list.tail = b_prev
        b_list.updateState()
        corner_lists.append(b_list)
    else: 
        corner_lists.pop(intersection_list)
    
    return corner_lists, b_list, ab_shard[0]
    
def iterLoop(corners): 
    current_corner = corners.head
    edges = []
    vertices = []
    
    for i in range(corners.length):
        edges.append(current_corner.next_edge)
        vertices.append(current_corner.vertex)
        current_corner = current_corner.next
    return edges, vertices

def nonDegenerateDecomposition(dir,corner_lists,regions,total_count):
    total_count = 0 
    for i in range(len(corner_lists)):
        total_count+=corner_lists[i].concave_count
        if(corner_lists[i].concave_count>0):
            current_corner = corner_lists[i].head
            while(current_corner.concave==False): 
                current_corner = current_corner.next
            corner_lists.insert(0,corner_lists.pop(i))
            break
    if(total_count==0):
        for corner_list in corner_lists:
            regions.append(cornersToCurve(corner_list))
        return regions
    else: 
        chord, intersection_corner, intersection_list, horver = extendCurve(current_corner,corner_lists,dir)
        corner_lists, b_list, vertex = doPartition(current_corner, chord, intersection_corner, intersection_list, corner_lists, horver, dir)
#        for i in range(len(corner_lists)):
#            print("Stats: ",i, corner_lists[i].length, corner_lists[i].concave_count)
        nonDegenerateDecomposition(dir,corner_lists,regions,total_count)
#        edges, vertex = iterLoop(corner_lists[-1])
#        return edges, vertex
"""
Main: 
I. filterConcaveVertices
II. find horziontal colinear vertices 
III. find vertical colinear vertices 
IV. if any exist, construct chords between cogrid vertices
V. Decompose
    a. Degenerate Decomposition 
        i. find maximum matching of a bipartite graph
    b. Non-degenerate Decomposition 
        i. extend curve at each concave vertex (choice between horizontal 
            and vertical can be random but favor whichever direction is parallel 
            with the longest length of the bounding box) 
        ii. doPartition 
            -create new vertex
            -traverse cornerslist in one direction until new region is closed 
                -while traversing, pop corners from old list and insert into new list
"""

concave, labelled_edges, corner_lists, bounding = filterConcaveVertices(curve)
x_col = findCogridVertices(concave, 0)
y_col = findCogridVertices(concave, 1)
deconstruct_bound = gh.DeconstuctRectangle(bounding)
if(deconstruct_bound.x_interval>=deconstruct_bound.y_interval):
    bias_dir=0
    cogrid_pairs = x_col+y_col
else: 
    bias_dir=1
    cogrid_pairs = y_col+x_col

regions = []
nonDegenerateDecomposition(bias_dir, corner_lists, regions,1)
#print("Decomposing...")
#edges, vertex = nonDegenerateDecomposition(bias_dir, corner_lists, regions,1)
#print("Decomposing...")
#edges, vertex = nonDegenerateDecomposition(bias_dir, corner_lists, regions,1)
#print("Decomposing...")
#edges, vertex = nonDegenerateDecomposition(bias_dir, corner_lists, regions,1)
#print("Decomposing...")
#edges, vertex = nonDegenerateDecomposition(bias_dir, corner_lists, regions,1)
#print("Decomposing...")
#edges, vertex = nonDegenerateDecomposition(bias_dir, corner_lists, regions,1)
#print("Decomposing...")
#edges, vertex = nonDegenerateDecomposition(bias_dir, corner_lists, regions,1)
#print("Decomposing...")
#edges, vertex = nonDegenerateDecomposition(bias_dir, corner_lists, regions,1)
#edges, vertex = iterLoop(corner_lists[2])
# ---------- end python ----------
python_2 = GhPythonScript(curve=crv)  # -> a, b, snapshots; inputs curve: list of Curve
# ---------- python_2: Python ----------
import ghpythonlib.components as gh
import rhinoscriptsyntax as rs 
import Rhino as rc 
import scriptcontext as sc
from itertools import chain
import math
import operator 
from operator import itemgetter
import random 

def argmin(a):
    return min(enumerate(a), key=itemgetter(1))[0]
    
def shortestSegment(csrf):  
    c_edge = gh.BrepEdges(csrf).naked
    c_join = gh.JoinCurves(c_edge,False)
    c_exp = gh.Explode(c_join,True).segments
    c_ext = gh.ExtendCurve(c_exp,0,0.001,0.001)
    c_add = gh.Addition(gh.GateNot(gh.SurfaceClosestPoint(gh.EndPoints(c_ext).start,csrf).distance),
                        gh.GateNot(gh.SurfaceClosestPoint(gh.EndPoints(c_ext).end,csrf).distance))
    c_add = gh.Addition(gh.Multiplication(gh.MassAddition(gh.Length(c_join)).result,c_add),
                        gh.Length(c_exp))
    c_series = gh.Series(0,1,gh.ListLength(c_exp))
    c_shortest = gh.ListItem(gh.SortList(c_add,c_series).values_a,0,True)
    return c_exp, int(c_shortest)
    
def getAdjacentSegments(segments, shortest):
    starts, ends = gh.EndPoints(segments)
    base_a, base_b = starts[shortest], ends[shortest]
    adj_a = None 
    adj_b = None
    for i in range(len(segments)):
        if(i==shortest):
            continue
        else: 
            if(adj_a!=None and adj_b!=None): 
                break
            if(starts[i]==base_a or ends[i]==base_a):
                adj_a = i 
            elif(starts[i]==base_b or ends[i]==base_b):
                adj_b = i
    return [adj_a, shortest, adj_a]

def lastRectangle(outline,ext):
    a = gh.Area(outline)
    b = gh.Area(ext)
    cent_dist = gh.Distance(a.centroid,b.centroid)
    abs_dif = gh.Absolute(gh.Subtraction(a.area,b.area))
    return (abs_dif<0.01 and cent_dist<0.01)
    
def searchIntersections(outline,base,normal,min_arm):
    base_ends = gh.EndPoints(base)
    discos = gh.Discontinuity(gh.BrepEdges(outline).naked, 1).points
    intersect = 1.0 
    
    dir_index = 0
    if(round(base_ends[0][0])==round(base_ends[1][0])):
        dir_index = 1
    op_index = (dir_index+1)%2
    a, b = sorted(base_ends, key = lambda co: co[dir_index])
    unit_normal = gh.UnitVector(normal) 
    oper = 'gt'
    if(unit_normal[op_index]<0):
        oper = 'lt'
        
    for pt in discos: 
        if(pt[dir_index]==a[dir_index] and pt[op_index]==b[op_index] or pt[dir_index]==b[dir_index] and pt[op_index]==b[op_index]):
            continue
        else:
            if(pt[dir_index]>=a[dir_index] and pt[dir_index]<=b[dir_index] and getattr(operator,oper)(pt[op_index],a[op_index])):
                param = abs(pt[op_index]-a[op_index])/min_arm
                if(param<intersect):
                    intersect=param
    return intersect
    
def createRoom(adjacents,segments,outline):
    arm_a = segments[adjacents[0]]
    base = segments[adjacents[1]]
    arm_b = segments[adjacents[2]]
    vec = gh.Vector2Pt(gh.EndPoints(base).start,gh.EndPoints(arm_a).start,False).vector
    min_arm = gh.Minimum(gh.Length(arm_a),gh.Length(arm_b))
    intersect = searchIntersections(outline, base, vec, min_arm)
    amp = gh.Amplitude(vec,min_arm*intersect)
    new_edge = gh.Move(base,amp).geometry
    base_a, base_b = gh.EndPoints(base)
    new_a = gh.LineSDL(base_a,amp,gh.VectorLength(amp))
    new_b = gh.Pufferfish.MoveToPoint(new_a, base_a, base_b).moved
    room = gh.BoundarySurfaces(gh.JoinCurves([base, new_a, new_b, new_edge],False))
    if(lastRectangle(outline,room)):
        return outline, room, True
    else: 
        split = gh.SplitBrep(outline, room)
        outline = split[1]
        return outline, room, False
    
    
outline = gh.BoundarySurfaces(curve)
b = gh.Area(outline).centroid
output = []
i = True
while(i==True):
    segments, shortest = shortestSegment(outline)
    adjacents = getAdjacentSegments(segments, shortest)
    remainder, room, last= createRoom(adjacents,segments,outline)
    output.append(room)
    b_curves = gh.JoinCurves(gh.BrepEdges(remainder).naked,False)
    if(last):
        i=False
    else: 
        if(isinstance(b_curves,list)):
            poly = []
            for c in b_curves:
                poly.append(gh.PolyLine(gh.Discontinuity(c,1).points,True))
        else:
            poly = gh.PolyLine(gh.Discontinuity(b_curves,1).points,True)
        outline = gh.BoundarySurfaces(poly)
a = output
# ---------- end python_2 ----------
python_3 = GhPythonScript()  # -> out, a
# ---------- python_3: Python ----------
import compas
from compas.datastructures import Mesh
from compas_ghpython.artists import MeshArtist

mesh = Mesh.from_obj(compas.get('faces.obj'))

a = MeshArtist(mesh).draw()
# ---------- end python_3 ----------
geo = Geometry(python.chord)
bool = Boolean(False)
python_4 = GhPythonScript(regions=python.regions, outline_cent=python_2.b)  # -> mepSpans, mepx, mepy; inputs regions: list of Curve, outline_cent: Point3d
# ---------- python_4: Python ----------
import ghpythonlib.components as gh
import rhinoscriptsyntax as rs 
import Rhino as rc 
import scriptcontext as sc
import math
import random 
import operator
import itertools

#class object initialized with "room" data 
#   -self.x & self.y: store midpoint lines generated by mepCross()
#   -self.x_range & self.y_range: extract and store the span of their respective midline 
class mepSpan:  
    def __init__(self,room):
        self.room = room
        self.x, self.y = self.mepCross(room)
        self.x_range = [(min(self.x[0][0],self.x[1][0])),(max(self.x[0][0],self.x[1][0]))]
        self.y_range = [(min(self.y[0][1],self.y[1][1])),(max(self.y[0][1],self.y[1][1]))]
        self.x_channel = []
        self.y_channel = []
        self.max_span = 13
        self.orient = [None,None]
        

    #calculates the difference of a given x_range or y_range
    def rangeLength(self,range):
        return range[1]-range[0]
        
    #returns the midpoint lines of a given parallelogram 
    #draws a line between the midpoint of opposing line segments 
    #NB: the ordering of segments resulting from gh.Explode() is not standard
    #   -to assign segment to appropriate variable (x or y), take the crossproduct of segment A and unit X
    def mepCross(self,room):
        edges = gh.Explode(room,True).segments
        edges = gh.Pufferfish.ReparameterizeCurve(edges).reparameterized
        a = gh.Line(gh.EvaluateCurve(edges[0],0.5).point,gh.EvaluateCurve(edges[2],0.5).point)
        b = gh.Line(gh.EvaluateCurve(edges[1],0.5).point,gh.EvaluateCurve(edges[3],0.5).point)
        if(gh.CrossProduct(gh.UnitY(1),a,False).length>=1):
            return a,b
        else:
            return b,a
    
    def addChannel(self,dir,vect):
        loc = int(dir=='x')
        attr = dir+'_channel'
        channel = getattr(self, attr)
        new = gh.Move(getattr(self,dir),vect).geometry
        index = len(channel)
        for el in range(len(channel)):
            if(channel[el][loc]<new[loc]):
                index = el
        channel.insert(index,new)
                         
            
#generic print function for debugging 
#prints the original (enumerated) index of spans as they appear in current 2D structuring
def printIndices(spans):
    ind = []
    for i in spans: 
        bunch = [] 
        for j in i:
            bunch.append(j[0])
        ind.append(bunch)
    print(ind)
    return(ind)
    
def checkOverlap(cur, max_east, min_west,dir):
    cur_east, cur_west = map(round,getattr(cur[1],dir))
    min_lap = min(20,abs(cur_west-cur_east)/8)
    within = False
    if(cur_east<=min_west and cur_west>=max_east):
        within = True
        if(cur_east>=max_east):
            max_east = cur_east
        if(cur_west<=min_west):
            min_west = cur_west
    return within, max_east, min_west
        
def runDir(overlapping, cur_north, cur_south, neighbors, opdir, max_east, min_west, dir):
    north, south = [list(a) for a in zip(*[map(round,getattr(obj[1],opdir)) for obj in overlapping])]
    if(cur_north not in south and cur_south not in north):
        return neighbors 
    else: 
        next_north, next_south = map(round,getattr(overlapping[0][1],opdir))
        within, new_east, new_west = checkOverlap(overlapping[0], max_east, min_west, dir)
        if(within):
            if(next_north == cur_south): 
                neighbors.append(overlapping[0])
                cur_south = next_south
                max_east = new_east
                min_west = new_west
            elif(next_south == cur_north):
                neighbors.insert(0,overlapping[0])
                cur_north = next_north
                max_east = new_east
                min_west = new_west
            else: 
                tmp = overlapping.pop(0)
                overlapping.append(tmp)
        else: 
            overlapping.pop(0)
        return runDir(overlapping,cur_north,cur_south,neighbors,opdir,max_east,min_west,dir)
                
def overlappingSpans(spans,cur,dir,opdir):
    east, west = zip(*[map(round,getattr(obj[1],dir)) for obj in spans])
    cur_east, cur_west = map(round,getattr(cur[1],dir))
    min_lap = min(20,abs(cur_west-cur_east)/8)
    overlapping = [cur]
    for i in range(len(spans)):
        if(cur_east+min_lap<west[i] and cur_west-min_lap>east[i]):
            overlapping.append(spans[i])
    contig = []
    if(len(overlapping)>1):
       cur_north, cur_south = map(round,getattr(overlapping[0][1],opdir))
       neighbors = runDir(overlapping[1:], cur_north, cur_south, [overlapping[0]], opdir, cur_east, cur_west, dir)
       contig = neighbors
    if(contig==[]):
        contig.append(overlapping[0])
    return contig
    
def reqColinear (spans,dir,opdir):
    colinear = []
    col_set = []
    enum = list(enumerate(spans))
    if(len(enum)==1):
        col_set.append(enum)
    else:
        for i in range(len(enum)):
            colinear.append(sorted(overlappingSpans(enum[:i]+enum[i+1:],enum[i],dir,opdir), key=lambda el: -len(el)))
        col_set = [list(y) for y in set(tuple(x) for x in colinear)]
    return col_set
            

def placeMEP(colinear,dir,edge=True,orient="interior"):
    dict = {'x_range':['y_range','x',1,lambda f: gh.UnitY(f)],
            'y_range':['x_range','y',0,lambda f: gh.UnitX(f)]}
    print(len(colinear))
    for i in range(len(colinear)):
        op_start, op_stop = zip(*[getattr(obj[1],dict[dir][0]) for obj in colinear[i]])
        SE, NW = max(op_start), min(op_stop)
        remainder = 0 
        if(edge==False):
            remainder = (NW-SE)%colinear[i][0][1].max_span
        edges = [SE+remainder, NW-remainder]
        card = ['E','W','S','N']
        if(orient=="interior"):
            shift = min(edges, key=lambda d: abs(outline_cent[dict[dir][2]]-d))
        else: 
            shift = max(edges, key=lambda d: abs(outline_cent[dict[dir][2]]-d))
        yadd = 2
        if(dir=='y_range'):
            yadd=0
        
        
        if((NW-SE)<=colinear[i][0][1].max_span):
            card = card[(edges.index(shift)+1)%2+yadd]
        else: 
            card = card[edges.index(shift)+yadd]
        for k in range(len(colinear[i])):
            span = colinear[i][k][1]
            mep = getattr(span,dict[dir][1])
            dif = shift-mep[0][dict[dir][2]]
            if(yadd==2):
                span.orient[1] = card
            else:
                span.orient[0] = card
            print(card)
            span.addChannel(dir[0],dict[dir][-1](dif))

spans = []  
for ele in regions:
    ele = mepSpan(ele)
    spans.append(ele)

xcol = reqColinear(spans,'x_range','y_range')
printIndices(xcol)
placeMEP(xcol,'y_range')

ycol = reqColinear(spans,'y_range','x_range')
printIndices(ycol)
placeMEP(ycol,'x_range')

mepx = []
mepy = []

for i in range(len(spans)):
    for j in spans[i].y_channel:
        mepy.append(j)
    for k in spans[i].x_channel:
        mepx.append(k)

mepSpans = spans
# ---------- end python_4 ----------
geo_2 = Geometry(python.regions)
geo_3 = Geometry(python.vertex)
geo_4 = Geometry(python.edges)
item = ListItem(List=python.edges, Index=number_slider, Wrap=bool)
item_2 = ListItem(List=geo_3, Index=number_slider, Wrap=bool)
number_slider_2 = Slider(5, range=0..10)
python_5 = GhPythonScript(mepSpans=python_4.mepSpans, i=number_slider_2)  # -> flatten(pts); inputs mepSpans: list, i: Int32
# ---------- python_5: Python ----------
import ghpythonlib.components as gh
import rhinoscriptsyntax as rs 
import Rhino as rc 
import scriptcontext as sc
import math
import random 
import operator
import itertools

"""pseudo 
CLT can be manufactured at almost any dimension but shipping imposes a constraint. The optimal span
length taking into account the dimensions of a typical flat-bed or shipping container comes out to 
13ft. Not every plot or floor plan will be evenly divisible by the optimal span length. It comes down
to a design question how to handle this for each section of a floor plan.  

Options: 
1. Justify 
We could keep regular non-optimal span lengths so that the spacing of columns is regular. 

2. Shift Modulo 
We keep the optimal span length and have at most 2 sides of a rectangle that have extra. These could
areas could be corridors where the columns are out of sight anyway. We can designate which two sides of 
a given section will be corridors. By default, we set the interior sides (those closest to the center of the 
floorplan to have the excess). 
"""


    
def getUpperLeft(pts):
    upperleft = pts[0]
    for i in range(len(pts)):
        min_x = round(upperleft[0])
        max_y = round(upperleft[1])
        if(round(pts[i][0])<=min_x and round(pts[i][1])>=max_y):
            upperleft = pts[i]
    return upperleft

def placeVertices(mepSpan):
    max_span = mepSpan.max_span
    orient = mepSpan.orient
    print(orient)
    upperleft = getUpperLeft(gh.Explode(mepSpan.room,True).vertices)
    
    
    x_range, y_range = mepSpan.x_range[1]-mepSpan.x_range[0], mepSpan.y_range[1]-mepSpan.y_range[0]
    latnum = int(x_range//max_span)+2
    longnum = int(y_range//max_span)+2 
    x_gen, y_gen= max_span, max_span
    
#    ref = upperleft
#    x_mult = 1
#    y_mult = 1
#    upperright = gh.Move(upperleft,gh.UnitX(x_range)).geometry
#    if(orient[0]=='E'):
#        ref = upperright
#        x_mult = -1
#    bottom = gh.Move(ref, gh.UnitY(-y_range)).geometry
#    if(orient[1]=='N'):
#        ref = bottom
#        y_mult = -1
#    pts = [ref]
#    x_range = x_range*x_mult 
#    y_range = -y_range*y_mult
#    for i in range(0,longnum):
#        for j in range(0,latnum):
#            if(i==0 and j==0):
#                continue
#            x_comp = x_gen*j*x_mult
#            y_comp = -y_gen*i*y_mult
#            if(j==latnum-1 and i==longnum-1):
#                vec = gh.VectorXYZ(x_range,y_range,0).vector
#            elif(j==latnum-1):
#                vec = gh.VectorXYZ(x_range,y_comp,0).vector
#            elif(i==longnum-1):
#                vec = gh.VectorXYZ(x_comp,y_range,0).vector
#            else: 
#                vec = gh.VectorXYZ(x_comp,y_comp,0).vector
#            pts.append(gh.Move(ref, vec).geometry)
    return pts

pts = []
for span in mepSpans:
    pts.extend(placeVertices(span))
#pts.extend(placeVertices(mepSpans[i]))
# ---------- end python_5 ----------
item_3 = ListItem(List=python_2.a, Index=number_slider_2, Wrap=True)
panel = Panel(python_5)
