# Grasshopper definition floor_plan_generator_parallel.gh (Grasshopper 1.0.7)

number_slider = Slider(4, range=0..15)
crv = Curve([<curve referenced from the Rhino model> x2])
python = GhPythonScript(curve=crv, y=number_slider)  # -> a, b, c_probe, search, short; inputs curve: list of Curve
# ---------- python: Python ----------
import ghpythonlib.components as gh
import rhinoscriptsyntax as rs 
import Rhino as rc 
import scriptcontext as sc
from itertools import chain
import math
from operator import itemgetter
import random 
from ghpythonlib.parallel import run
def argmin(a):
    return min(enumerate(a), key=itemgetter(1))[0]
    
def shortestSegment(csrf):  
    c_edge = gh.BrepEdges(csrf).naked
    c_join = gh.JoinCurves(c_edge,False)
    c_exp = gh.Explode(c_join,True).segments
    c_ext = gh.ExtendCurve(c_exp,0,0.001,0.001)
    c_add = gh.Addition(gh.GateNot(gh.SurfaceClosestPoint(gh.EndPoints(c_ext).start,csrf).distance),
                        gh.GateNot(gh.SurfaceClosestPoint(gh.EndPoints(c_ext).end,csrf).distance))
    c_add = gh.Addition(gh.Multiplication(gh.MassAddition(gh.Length(c_join)).result,c_add),
                        gh.Length(c_exp))
    c_series = gh.Series(0,1,gh.ListLength(c_exp))
    c_shortest = gh.ListItem(gh.SortList(c_add,c_series).values_a,0,True)
    return c_exp, c_series, int(c_shortest)

def getAdjacentSegments(segments, series, shortest):
    cull = segments[0:shortest]+segments[shortest+1:]
    adj_a = gh.CurveClosestPoint(gh.EndPoints(segments[shortest]).start,cull).distance
    adj_a.insert(shortest, 9999)
    adj_b = gh.CurveClosestPoint(gh.EndPoints(segments[shortest]).end,cull).distance
    adj_b.insert(shortest, 9999)
    return [argmin(adj_a),shortest,argmin(adj_b)]

def lastRectangle(outline,ext):
    a = gh.Area(outline)
    b = gh.Area(ext)
    cent_dist = gh.Distance(a.centroid,b.centroid)
    abs_dif = gh.Absolute(gh.Subtraction(a.area,b.area))
    return (abs_dif<0.01 and cent_dist<0.01)
    
def searchIntersections(args):
    probe, wo_adj = args
    intersections = gh.CurveXCurve(probe,wo_adj).params_a
    if(intersections==None):
        return []
    else: 
        return intersections
        
def calculateAmplitude(adjacents,segments):
    arm_a = segments[adjacents[0]]
    base = segments[adjacents[1]]
    arm_b = segments[adjacents[2]]
    adjs = [arm_a,base,arm_b]
    vec = gh.Vector2Pt(gh.EndPoints(base).start,gh.EndPoints(arm_a).start,False).vector
    min_arm = gh.Minimum(gh.Length(arm_a),gh.Length(arm_b))
    wo_adj = list(segments)
    for index in sorted(adjacents, reverse=True):
        del wo_adj[index]
    wo_adj = gh.Pufferfish.ReparameterizeCurve(gh.JoinCurves(wo_adj,False)).reparameterized
    probes = gh.LineSDL(gh.DivideCurve(base,50,False).points[1:-1],vec,min_arm)
    intersects = []
    if(isinstance(wo_adj,list)):
        for j in wo_adj:
            pass_arg = [[probe, j] for probe in probes]
            intersects.extend(run(searchIntersections,pass_arg,False))
    else:
        pass_arg = [[probe, wo_adj] for probe in probes]
        intersects.extend(run(searchIntersections,pass_arg,False))
    if(intersects==[]):
        mult = min_arm
    else:
        mult = gh.Multiplication(min_arm, min(intersects))
    return gh.Amplitude(vec,mult)
outline = gh.BoundarySurfaces(curve)
output = []
b = []
i = 0
while(i<14):
    segments, series, shortest = shortestSegment(outline)
    adjacents = getAdjacentSegments(segments, series, shortest)
    amp = calculateAmplitude(adjacents,segments)
    ext = gh.Extrude(segments[adjacents[1]],amp)
    b_solid = gh.Extrude(gh.Move(ext,gh.VectorXYZ(0,0,-1).vector).geometry,gh.VectorXYZ(0,0,2).vector)
    b_edges = gh.BrepEdges(gh.TrimSolid(outline,b_solid)).naked
    b_curves = gh.JoinCurves(b_edges,False)
    if(isinstance(b_curves,list)):
        poly = []
        for c in b_curves:
            poly.append(gh.PolyLine(gh.Discontinuity(c,1).points,True))
    else:
        poly = gh.PolyLine(gh.Discontinuity(b_curves,1).points,True)
    output.append(ext)
    if(lastRectangle(outline,ext)):
        i=14
    else: 
        outline = gh.BoundarySurfaces(poly)
    i+=1
a = output
# ---------- end python ----------
crv_2 = Curve(<curve referenced from the Rhino model>)
lng = ListLength(List=python.a)
crv_3 = Curve(<curve referenced from the Rhino model>)
python_2 = GhPythonScript(regions=python.a)  # -> mepy, mepx; inputs regions: list of Surface
# ---------- python_2: Python ----------
import ghpythonlib.components as gh
import rhinoscriptsyntax as rs 
import Rhino as rc 
import scriptcontext as sc
import math
import random 
import operator
import itertools

#class object initialized with "room" data 
#   -self.x & self.y: store midpoint lines generated by mepCross()
#   -self.x_range & self.y_range: extract and store the span of their respective midline 
class mepSpan:  
    def __init__(self,room):
        self.x, self.y = self.mepCross(room)
        self.x_range = [round(min(self.x[0][0],self.x[1][0])),round(max(self.x[0][0],self.x[1][0]))]
        self.y_range = [round(min(self.y[0][1],self.y[1][1])),round(max(self.y[0][1],self.y[1][1]))]
        self.x_channel = []
        self.y_channel = []
    #calculates the difference of a given x_range or y_range
    def rangeLength(self,range):
        return range[1]-range[0]
        
    #returns the midpoint lines of a given parallelogram 
    #draws a line between the midpoint of opposing line segments 
    #NB: the ordering of segments resulting from gh.Explode() is not standard
    #   -to assign segment to appropriate variable (x or y), take the crossproduct of segment A and unit X
    def mepCross(self,room):
        edges = gh.Explode(room,True).segments
        edges = gh.Pufferfish.ReparameterizeCurve(edges).reparameterized
        a = gh.Line(gh.EvaluateCurve(edges[0],0.5).point,gh.EvaluateCurve(edges[2],0.5).point)
        b = gh.Line(gh.EvaluateCurve(edges[1],0.5).point,gh.EvaluateCurve(edges[3],0.5).point)
        if(gh.CrossProduct(gh.UnitY(1),a,True).length):
            return a,b
        else:
            return b,a
    
    def addChannel(self,dir,vect):
        if(dir=='x'):
            self.x_channel.append(gh.Move(self.x,vect).geometry)
        else: 
            self.y_channel.append(gh.Move(self.y,vect).geometry)
            
#generic print function for debugging 
#prints the original (enumerated) index of spans as they appear in current 2D structuring
def printIndices(spans):
    ind = []
    for i in spans: 
        bunch = [] 
        for j in i:
            bunch.append(j[0])
        ind.append(bunch)
    print(ind)
    return(ind)

def overlappingSpans(spans,cur,dir,opdir):
    east, west = zip(*[getattr(obj[1],dir) for obj in spans])
    cur_east = getattr(cur[1],dir)[0]
    cur_west = getattr(cur[1],dir)[1]
    min_lap = min(20,abs(cur_west-cur_east)/8)
    overlapping = [cur]
    for i in range(len(spans)):
        if(cur_east+min_lap<west[i] and cur_west-min_lap>east[i]):
            overlapping.append(spans[i])
    #printIndices([overlapping])
    contig = []
    if(len(overlapping)>1):
        north,south = [list(a) for a in zip(*[getattr(obj[1],opdir) for obj in overlapping])]
        for j in range(len(overlapping)):
            cur_north = north[j]
            cur_south = south[j]
            if(cur[0]==4):
                print(overlapping[j][0],cur_north,cur_south)
            if(cur_north in south or cur_south in north):
                contig.append(overlapping[j])
            elif(j==0):
                break
    printIndices([contig])
    if(contig==[]):
        contig.append(overlapping[0])
    return contig

def reqColinear (spans,dir,opdir):
    colinear = []
    col_set = []
    enum = list(enumerate(spans))
    if(len(enum)==1):
        col_set.append(enum)
    else:
        for i in range(len(enum)):
            colinear.append(sorted(overlappingSpans(enum[:i]+enum[i+1:],enum[i],dir,opdir)))
        col_set = [list(y) for y in set(tuple(x) for x in colinear)]
        for i in range(2,len(col_set)):
            for x in itertools.combinations(col_set,i):
                check_set = sorted(set().union(*x))
                if(check_set in col_set):
                    col_set.remove(check_set)
    return col_set

def placeMEP(colinear,dir):
    #dictionary to handle x and y flows 
    dict = {'x_range':['y_range','x',1,lambda f: gh.UnitY(f)],
            'y_range':['x_range','y',0,lambda f: gh.UnitX(f)]}
    if(len(colinear)==1):
        colinear[0][0][1].addChannel(dir[0],dict[dir][-1](0))
    else:
        for i in range(len(colinear)):
            if(len(colinear[i])==1):
                colinear[i][0][1].addChannel(dir[0],dict[dir][-1](0))
            else:
                op_start, op_stop = zip(*[getattr(obj[1],dict[dir][0]) for obj in colinear[i]])
                mdpnt = max(op_start)+(min(op_stop)-max(op_start))/2
                for k in range(len(colinear[i])):
                    span = colinear[i][k][1]
                    mep = getattr(span,dict[dir][1])
                    dif = mdpnt-mep[0][dict[dir][2]]
                    span.addChannel(dir[0],dict[dir][-1](dif))
spans = []  
for ele in regions:
    ele = mepSpan(ele)
    spans.append(ele)

xcol = reqColinear(spans,'x_range','y_range')
printIndices(xcol)
placeMEP(xcol,'y_range')
#printIndices(xcol)

#sortalgo = lambda e: (-e[1].y_range[0],-(e[1].rangeLength(e[1].y_range)))
ycol = reqColinear(spans,'y_range','x_range')
printIndices(ycol)
placeMEP(ycol,'x_range')
#printIndices(ycol)

mepx = []
mepy = []
for i in range(len(spans)):
    for j in spans[i].y_channel:
        mepy.append(j)
    for k in spans[i].x_channel:
        mepx.append(k)
# ---------- end python_2 ----------
item = ListItem(List=python.a, Index=number_slider, Wrap=True)
geo = Geometry()
geo_2 = Geometry(python.b)
geo_3 = Geometry(python.c_probe)
geo_4 = Geometry(python.search)
python_3 = GhPythonScript(x=crv_2, y=crv_3)  # -> a, b; inputs x: Curve, y: Curve
# ---------- python_3: Python ----------
import ghpythonlib.components as gh
import rhinoscriptsyntax as rs 
import Rhino as rc 
import scriptcontext as sc
from itertools import chain
import math
from operator import itemgetter
import random 

x = gh.LineSDL(gh.DivideCurve(x,50,False).points[1:-1],gh.UnitY(-1),1000)
a = gh.CurveXCurve(x,y).params_a
print(a)
# ---------- end python_3 ----------
lng_2 = ListLength()
panel = Panel(lng_2)
srf = Surface(item)
geo_5 = Geometry(python_2.mepy)
wheel = ColourWheel(
    ColourGrips_Style=10,
    ColourGrips_Grip=[3.007111518, 2.094395102, 4.188790205, 3.141592654],
    ColourGrips_Lum=[0.5254568016, 1],
    ColourGrips_Range=[2.234915932, 2.234915932, 2.234915932, 2.234915932],
    ColourGrips_Sat=[0.4205154395, 1])
geo_6 = Geometry(python_2.mepx)
mesh = Mesh(python.a)
srf_2 = Surface(python.a)
preview = CustomPreview(Geometry=mesh, Material=wheel)
